# Dynamo graph v00 Filtering Joists.dyn (Dynamo 2.12.1.8246)
# packages: Rhythm 2022.3.3

# group: Calculations / Data Processing (Dynamo)
# note: Calculations / Data Processing

# group: Creating / Manipulating Elements in Revit
# note: Creating Elements in Revit.

# group: Writing Data, to Revit, Excel, Etc.
# note: Writing to Revit, Excel, Etc.

# group: Reading Data from Revit, Excel, Etc.
# note: Reading Data from Revit, Excel, Etc.

# group: User Inputs
# note: User Inputs: Blue

# group: User Notes ; Revit/Parameter Prerequisites/ Authorship
# note: Required Parameters in Revit:
# Required Families:
# Needs the Sphere of Disturbance Loaded
# note: Created by: Austin Guter AHG
# Date: 07/20/2022
# License = MIT License

# group: Load Sphere of Disturbance
family_types = FamilyTypes("Sphere of Disturbance:Sphere of Disturbance")

# group: Finding the Unique points to Check End Bearing
categories = Categories("OST_StructuralFraming")
checking_for_these_joist_names = CodeBlock { ["K-Series","LH-Series"]; }
filters_for_k_series_and_lh = Python(IN[0]=categories, IN[1]=checking_for_these_joist_names)  # "Filters for K-Series and LH-Series Joists (3d view only)"; CPython3
# ---------- filters_for_k_series_and_lh.python (24 lines) ----------
import clr
clr.AddReference('RevitAPI')
from Autodesk.Revit.DB import *
clr.AddReference('RevitServices')
from RevitServices.Persistence import DocumentManager

doc = DocumentManager.Instance.CurrentDBDocument

category = UnwrapElement(IN[0])
joists = IN[1]
elements = FilteredElementCollector(doc, doc.ActiveView.Id)\
		.OfCategoryId(category.Id)\
		.WhereElementIsNotElementType()

filtered = []
for e in elements:
	type_id = e.GetTypeId()
	element_type = doc.GetElement(type_id)
	family = element_type.Family
	name = family.Name
	if joists[1] in name or joists[0] in name:
		filtered.append(e)
	
OUT = filtered
# ----------------------------------------
find_all_end_points_of_the = Python(IN[0]=filters_for_k_series_and_lh)  # "Find All End Points of the Joists"; CPython3
# ---------- find_all_end_points_of_the.python (17 lines) ----------
import clr
clr.AddReference('RevitAPI')
from Autodesk.Revit.DB import *
clr.AddReference('RevitServices')
from RevitServices.Persistence import DocumentManager


joists = UnwrapElement(IN[0])
pnts = []

for joist in joists:
	start = joist.Location.Curve.GetEndPoint(0)
	end = joist.Location.Curve.GetEndPoint(1)
	pnts.append(start)
	pnts.append(end)
	
OUT = pnts
# ----------------------------------------
tolerance = CodeBlock { 1; }
pythong_finds_unique_points = Python(IN[0]=find_all_end_points_of_the, IN[1]=tolerance)  # CPython3
# ---------- pythong_finds_unique_points.python (52 lines) ----------
# Load the Python Standard and DesignScript Libraries
import sys
import clr
clr.AddReference('ProtoGeometry')
from Autodesk.DesignScript.Geometry import *

# The inputs to this node will be stored as a list in the IN variables.
pnts = IN[0]
tol = IN[1]

# Place your code below this line
def distance(point1,point2) :
	x1 = point1.X
	y1 = point1.Y
	z1 = point1.Z
	x2 = point2.X
	y2 = point2.Y
	z2 = point2.Z
	dist = ((x2-x1)**2+(y2-y1)**2+(z2-z1)**2)**0.5
	return dist
	
uni_pnts = []
temp_pnts = pnts
while len(temp_pnts) >= 1:
	if len(temp_pnts) != 1:
		pnt_init = temp_pnts[0]
		rem_pnts = temp_pnts[1:]
		j = 0
		on_off = 1
		while on_off >= 0.5:
			delta = distance(pnt_init,rem_pnts[j])
			if delta <= tol :
				uni_pnts.append(pnt_init)
				temp_pnts.pop(j+1)
				temp_pnts.pop(0)
				on_off = 0
			elif j == len(rem_pnts)-1:
				uni_pnts.append(pnt_init)
				temp_pnts.pop(0)
				on_off = 0
			else:
				j+=1
	else:
		uni_pnts.append(temp_pnts[0])
		temp_pnts.pop(0)
		
			
			
			
	
# Assign your output to the OUT variable.
OUT = uni_pnts
# ----------------------------------------

# group: Bounding Box Creation
size = CodeBlock { 0.5; }
python_script_bounding_box = Python(IN[0]=pythong_finds_unique_points, IN[1]=size)  # "Python Script (bounding box location)"; IronPython2
# ---------- python_script_bounding_box.python (25 lines) ----------
# Load the Python Standard and DesignScript Libraries
import sys
import clr
clr.AddReference('ProtoGeometry')
from Autodesk.DesignScript.Geometry import *

# The inputs to this node will be stored as a list in the IN variables.
pnts = IN[0]
size = IN[1]
def pnt_add_neg(point):
	x = point.X
	y = point.Y
	z = point.Z
	
	pnt_1 = Point.ByCoordinates(x-size,y-size,z-size)
	pnt_2 = Point.ByCoordinates(x+size,y+size,z+size)
	return pnt_1,pnt_2
# Place your code below this line

bb_pnts = []
for i in pnts:
	bb_pnts.append(pnt_add_neg(i))
	
# Assign your output to the OUT variable.
OUT = bb_pnts
# ----------------------------------------
code_block = CodeBlock { 0; }
getItemAtIndex = List.GetItemAtIndex(list=python_script_bounding_box@L2, index=code_block)
code_block_2 = CodeBlock { 1; }
getItemAtIndex_2 = List.GetItemAtIndex(list=python_script_bounding_box@L2, index=code_block_2)
byCorners = BoundingBox.ByCorners(min=getItemAtIndex, max=getItemAtIndex_2)

toCuboid = BoundingBox.ToCuboid(boundingBox=byCorners)
location = StructuralFraming.Location(structuralFraming=filters_for_k_series_and_lh)

# group: Checking all joists to see if they intersect all beams. heavy number crunching
# note: Maybe add preprocessing to reduce number of checks done
doesIntersect = Geometry.DoesIntersect(geometry=toCuboid, other=location@L2, lacing=Longest)

testing_for_double_or_single_lh = Python(IN[0]=doesIntersect, IN[1]=filters_for_k_series_and_lh)  # "Testing for double or single LH or K-Series"; IronPython2
# ---------- testing_for_double_or_single_lh.python (22 lines) ----------
# Load the Python Standard and DesignScript Libraries
import sys
import clr
clr.AddReference('ProtoGeometry')
from Autodesk.DesignScript.Geometry import *

# The inputs to this node will be stored as a list in the IN variables.
t_f = IN[0]
joists = IN[1]

joist_type = []
for i in t_f:
	temp = []
	for ind, x in enumerate(i):
		if x:
			temp.append(joists[ind])
		else:
			pass
	joist_type.append(temp)
	
# Assign your output to the OUT variable.
OUT = joist_type
# ----------------------------------------
name = FamilyType.Name(familyType=testing_for_double_or_single_lh)

# group: Finding Where Wide Flange Beams Exist
categories_2 = Categories("OST_StructuralFraming")
checking_for_these_joist_names_2 = CodeBlock { ["W-Wide Flange"]; }
filters_for_k_series_and_lh_2 = Python(IN[0]=categories_2, IN[1]=checking_for_these_joist_names_2)  # "Filters for K-Series and LH-Series Joists (3d view only)"; CPython3
# ---------- filters_for_k_series_and_lh_2.python (24 lines) ----------
import clr
clr.AddReference('RevitAPI')
from Autodesk.Revit.DB import *
clr.AddReference('RevitServices')
from RevitServices.Persistence import DocumentManager

doc = DocumentManager.Instance.CurrentDBDocument

category = UnwrapElement(IN[0])
joists = IN[1]
elements = FilteredElementCollector(doc, doc.ActiveView.Id)\
		.OfCategoryId(category.Id)\
		.WhereElementIsNotElementType()

filtered = []
for e in elements:
	type_id = e.GetTypeId()
	element_type = doc.GetElement(type_id)
	family = element_type.Family
	name = family.Name
	if joists[0] in name:
		filtered.append(e)
	
OUT = filtered
# ----------------------------------------
location_2 = StructuralFraming.Location(structuralFraming=filters_for_k_series_and_lh_2)
boundingBox = Geometry.BoundingBox(geometry=location_2)

# group: find beam at specific node
# note: Test Wether the bar joist crosses the beam
intersects = BoundingBox.Intersects(boundingBox=byCorners, other=boundingBox@L2, lacing=Longest)

testing_for_double_or_single_lh_2 = Python(IN[0]=intersects, IN[1]=filters_for_k_series_and_lh_2)  # "Testing for double or single LH or K-Series"; IronPython2
# ---------- testing_for_double_or_single_lh_2.python (22 lines) ----------
# Load the Python Standard and DesignScript Libraries
import sys
import clr
clr.AddReference('ProtoGeometry')
from Autodesk.DesignScript.Geometry import *

# The inputs to this node will be stored as a list in the IN variables.
t_f = IN[0]
beam = IN[1]

beam_type = []
for i in t_f:
	temp = []
	for ind, x in enumerate(i):
		if x:
			temp.append(beam[ind])
		else:
			pass
	beam_type.append(temp)
	
# Assign your output to the OUT variable.
OUT = beam_type
# ----------------------------------------
code_block_3 = CodeBlock { "bf"; }
ʳʰʸᵗʰᵐ_elements = Rhythm.Revit.Elements.Elements.GetParameterValueByNameTypeOrInstance(element=testing_for_double_or_single_lh_2, parameterName=code_block_3)
test_beam_width_to_joist_type = Python(IN[0]=name, IN[1]=ʳʰʸᵗʰᵐ_elements, IN[2]=pythong_finds_unique_points)  # IronPython2
# ---------- test_beam_width_to_joist_type.python (48 lines) ----------
# Load the Python Standard and DesignScript Libraries
import sys
import clr
clr.AddReference('ProtoGeometry')
from Autodesk.DesignScript.Geometry import *

# The inputs to this node will be stored as a list in the IN variables.
joist_types = IN[0]
beam_widths = IN[1]
pnts = IN[2]

pnts_failing = []
for ind, (joist,beam_width) in enumerate(zip(joist_types,beam_widths)):
   if len(joist)==1:
       if "K" in joist[0]:
           min_seat = 0.3333
           if beam_width[0] <= min_seat:
               pnts_failing.append(pnts[ind])
           else:
               pass
       else:
           min_seat = 0.5
           if beam_width[0] <= min_seat:
               pnts_failing.append(pnts[ind])
           else:
               pass
   else:
       if "LH" in joist[0] or "LH" in joist[1]:
           min_seat = 1
           if beam_width[0] <= min_seat:
               pnts_failing.append(pnts[ind])
           else:
               pass
       else:
           min_seat = 0.67
           if beam_width[0] <= min_seat:
               pnts_failing.append(pnts[ind])
           else:
               pass
                
       
            
            
           
	           
	
# Assign your output to the OUT variable.
OUT = pnts_failing
# ----------------------------------------
# note: Just had to import something for this to work
convert_to_geometry_point = Python(IN[0]=test_beam_width_to_joist_type)  # IronPython2
# ---------- convert_to_geometry_point.python (23 lines) ----------
# Load the Python Standard and DesignScript Libraries
import clr
clr.AddReference('ProtoGeometry')
from Autodesk.DesignScript.Geometry import *

clr.AddReference("RevitNodes")
import Revit
clr.ImportExtensions(Revit.Elements)

clr.ImportExtensions(Revit.GeometryConversion)


# The inputs to this node will be stored as a list in the IN variables.
pnts = UnwrapElement(IN[0])
test = []
for x in pnts:
	test.append(x.ToPoint())

       
            
	
# Assign your output to the OUT variable.
OUT = test
# ----------------------------------------

# group: Create Spheres @ spots where SJI is voilated
byPoint = FamilyInstance.ByPoint(familyType=family_types, point=convert_to_geometry_point@L1)

popup_window = Python(IN[0]=test_beam_width_to_joist_type)  # IronPython2
# ---------- popup_window.python (31 lines) ----------
# Load the Python Standard and DesignScript Libraries
import sys
import clr
clr.AddReference('RevitAPIUI')
from Autodesk.Revit.UI import TaskDialog, TaskDialogCommonButtons, TaskDialogResult, TaskDialogCommandLinkId

data = IN[0]

mainDialog = TaskDialog("K Series and LH-Series Beam Flange Checker")
if len(data) is None:
	mainDialog.MainInstruction = ("All beam flange widths appear adequate")
	mainDialog.MainContent = """PLEASE STILL REVIEW ALL BEAMS AND JOISTS FOR ACCURACY"""


	mainDialog.CommonButtons = TaskDialogCommonButtons.Close;
	mainDialog.DefaultButton = TaskDialogResult.Close;

	mainDialog.FooterText = "Thanks for using this tool. Reach out to Austin Guter with any questions or comments"
else:

	mainDialog.MainInstruction = (str(len(data))+ " beam flanges were not of adequate length for the minimum joist bearing required by SJI")
	mainDialog.MainContent = """PLEASE REVIEW ALL RED ORBS."""


	mainDialog.CommonButtons = TaskDialogCommonButtons.Close;
	mainDialog.DefaultButton = TaskDialogResult.Close;

	mainDialog.FooterText = "Thanks for using this tool. Reach out to Austin Guter with any questions or comments"

tResult = mainDialog.Show()
OUT = tResult
# ----------------------------------------
