# Dynamo graph test for height between floors..dyn (Dynamo 2.19.3.6394)

categories = Categories("OST_Walls")
all_elements_of_category = ElementsOfCategory(Category=categories)

# group: Top Coordinate of the Floor
categories_2 = Categories("OST_Floors")
all_elements_of_category_2 = ElementsOfCategory(Category=categories_2)
faces = Element.Faces(element=all_elements_of_category_2)
code_block = CodeBlock { 1; }
getItemAtIndex = List.GetItemAtIndex(list=faces@L2, index=code_block)
code_block_2 = CodeBlock { 0.5; }
pointAtParameter = Surface.PointAtParameter(surface=getItemAtIndex, u=code_block_2, v=code_block_2)
Z = Point.Z(point=pointAtParameter)

# group: Top Coordinate of the Window
categories_3 = Categories("OST_Windows")
all_elements_of_category_3 = ElementsOfCategory(Category=categories_3)
faces_2 = Element.Faces(element=all_elements_of_category_3)
byGeometry = BoundingBox.ByGeometry(geom=faces_2)
maxPoint = BoundingBox.MaxPoint(boundingBox=byGeometry)
Z_2 = Point.Z(point=maxPoint)

sub = Z@L1 - Z_2
